# Grasshopper definition VerwendungExternerBibliothek_Cs_00.gh (Grasshopper 1.0.4)
# plug-ins: Weaverbird

pt = Point(Point(-0.9529820765, -1.251859291, 0))
pt_2 = Point(Point(0.9987959832, 1.077951599, 0))
rec_2pt = Rectangle2Pt(Plane=PlaneXY(0, 0, 0), PointA=pt, PointB=pt_2, Radius=0)  # -> Rectangle, Length
mplane = MeshPlane(Boundary=rec_2pt.Rectangle, WidthCount="3", HeightCount="3")  # -> Mesh, Area
tri = Triangulate(Mesh=mplane.Mesh)  # -> Mesh, Count
c_script = CSharpScript(iMesh=tri.Mesh, iJitter="0.2")  # -> out, oMesh; inputs iMesh: Mesh, iJitter: Double
# ---------- c_script: C# ----------
    Random random = new Random();
    for (int i = 0; i < iMesh.Vertices.Count; i++)
    {
      Point3d v = new Point3d(iMesh.Vertices[i]);
      iMesh.Vertices.SetVertex(
        i,
        v.X + iJitter * (2.0 * random.NextDouble() - 1.0),
        v.Y + iJitter * (2.0 * random.NextDouble() - 1.0),
        v.Z + iJitter * (2.0 * random.NextDouble() - 1.0));
    }
    oMesh = iMesh;
# ---------- end c_script ----------
bending_resistance_weight = Slider(3, range=0..20)
edgelength_weight = Slider(1, range=0..10)
collision_distance = Slider(1, range=0..10)
collision_weight = Slider(4, range=0..10)
sub_iteration = Slider(1, range=0..30)
max_vertex_count = Panel("2000")
r_tree = BooleanToggle(True)
reset = Button()
timer = Timer(TimerInterval=1, Target=c_script_2)  # disabled
grow = BooleanToggle(True)
starting_mesh = Mesh(c_script.oMesh)
c_script_2 = CSharpScript(
    IReset=reset,
    IStartingMesh=starting_mesh,
    ISubiterationCount=sub_iteration,
    IGrow=grow,
    IMaxVertexCount=max_vertex_count,
    IEdgeLengthConstraintWeight=edgelength_weight,
    ICollisionDistance=collision_distance,
    ICollisionWeight=collision_weight,
    IBendingResistanceWeight=bending_resistance_weight,
    IUseRTree=r_tree)  # -> Out, OMesh
level = Slider(1, range=0..4)
mesh = Mesh(c_script_2.OMesh)
wbloop = WeaverbirdsLoopSubdivision(MeshCurves=mesh, Level=level, SmoothNakedEdges=1)
preview = CustomPreview(Geometry=wbloop, Material=ColourSwatch(SwatchColor=RGB(230, 230, 230)))
