# Grasshopper definition DeCasteljauAlgorithm_Completed.gh (Grasshopper 0.9.76)

# Adaptively subdividing a curve
# (De Casteljau's algorithm)
number_slider = Slider(0.32, range=0.01..3)
curve = Curve(reparameterize(<curve referenced from the Rhino model>))
c_script = CSharpScript(curve=curve, tolerance=number_slider)  # -> out, outputSegments; inputs curve: Curve, tolerance: Double
# ---------- c_script: C# ----------
    List<LineCurve> segments = new List<LineCurve>();
    divideCurve(curve, 0.0, 1.0, tolerance, segments);
    outputSegments = segments;
# ---------- c_script: C# additional code ----------
  void divideCurve(Curve curve, double tStart, double tEnd, double tolerance, List<LineCurve> segments)
  {
    Point3d startPoint = curve.PointAt(tStart);
    Point3d endPoint = curve.PointAt(tEnd);
    Point3d middlePoint = 0.5 * (startPoint + endPoint);

    double t;
    curve.ClosestPoint(middlePoint, out t);

    double distance = curve.PointAt(t).DistanceTo(middlePoint);

    if (distance < tolerance)
    {
      segments.Add(new LineCurve(startPoint, endPoint));
    }
    else
    {
      double tMiddle = 0.5 * (tStart + tEnd);
      divideCurve(curve, tStart, tMiddle, tolerance, segments);
      divideCurve(curve, tMiddle, tEnd, tolerance, segments);
    }
  }
# ---------- end c_script ----------
