# Grasshopper definition CircleRelaxation_00.gh (Grasshopper 1.0.4)

c_script = CSharpScript(iCount="50")  # -> out, oPoints; inputs iCount: Int32
# ---------- c_script: C# ----------
    Random myRandomGenerator = new Random();

    List<Point3d> points = new List<Point3d>();

    for (int i = 0; i < iCount; i++)
    {
      double x = myRandomGenerator.NextDouble() * 6.0 - 3.0;
      double y = myRandomGenerator.NextDouble() * 6.0 - 3.0;
      double z = 0.0;
      Point3d myRandomPoint = new Point3d(x, y, z);
      points.Add(myRandomPoint);
    }

    oPoints = points;
# ---------- end c_script ----------
c_script_2 = CSharpScript(iStartingPositions=c_script.oPoints, iIterationCount=Slider(1, range=0..200))  # -> out, oGeometry; inputs iStartingPositions: list of Point3d, iIterationCount: Int32
# ---------- c_script_2: C# additional code ----------
  List<Point3d> centers;
# ---------- end c_script_2 ----------
cir = Circle(Plane=c_script_2.oGeometry, Radius="1")
