# Grasshopper definition CircleRelaxation_Completed.gh (Grasshopper 1.0.4)

c_script = CSharpScript(iCount="100")  # -> out, oPoints; inputs iCount: Int32
# ---------- c_script: C# ----------
    Random myRandomGenerator = new Random();

    List<Point3d> points = new List<Point3d>();

    for (int i = 0; i < iCount; i++)
    {
      double x = myRandomGenerator.NextDouble() * 6.0 - 3.0;
      double y = myRandomGenerator.NextDouble() * 6.0 - 3.0;
      double z = 0.0;
      Point3d myRandomPoint = new Point3d(x, y, z);
      points.Add(myRandomPoint);
    }

    oPoints = points;
# ---------- end c_script ----------
timer = Timer(TimerInterval=1, Target=c_script_2)  # disabled
c_script_2 = CSharpScript(iReset=Button(), iStartingPositions=c_script.oPoints)  # -> out, oCenters; inputs iReset: Boolean, iStartingPositions: list of Point3d
# ---------- c_script_2: C# ----------
    if (iReset || centers == null)
      centers = new List<Point3d>(iStartingPositions);

    List<Vector3d> totalMoves = new List<Vector3d>();
    List<double> collisionCounts = new List<double>();

    for (int i = 0; i < centers.Count; i++)
    {
      totalMoves.Add(new Vector3d(0.0, 0.0, 0.0));
      collisionCounts.Add(0.0);
    }

    double collisionDistance = 2.0;

    for (int i = 0; i < centers.Count; i++)
      for (int j = i + 1; j < centers.Count; j++)
      {
        double d = centers[i].DistanceTo(centers[j]);
        if (d > collisionDistance) continue;
        Vector3d move = centers[i] - centers[j];
        move.Unitize();
        move *= 0.5 * (collisionDistance - d);
        totalMoves[i] += move;
        totalMoves[j] -= move;
        collisionCounts[i] += 1.0;
        collisionCounts[j] += 1.0;
      }

    for (int i = 0; i < centers.Count; i++)
      if (collisionCounts[i] != 0.0)
        centers[i] += totalMoves[i] / collisionCounts[i];;

    oCenters = centers;
# ---------- c_script_2: C# additional code ----------
  List<Point3d> centers;
# ---------- end c_script_2 ----------
cir = Circle(Plane=c_script_2.oCenters, Radius="1")
