# Grasshopper definition SubdivisionCurve_Completed.gh (Grasshopper 0.9.76)

# Subdivision Curve (Chaikin scheme)
iterationcount = Slider(10, range=0..10)
pt = Point([Point(-4.897308965, 7.724109416, 0), Point(-0.8949092658, -0.5445844675, 0), Point(4.426962861, 7.240302859, 0), Point(10.14467672, -1.29228551, 0), Point(14.54291814, 7.636144588, 0), Point(20.17266717, -0.1047603248, 0), Point(23.91117239, 8.07596873, 0)])
c_script = CSharpScript(controlPoints=pt, iterationCount=iterationcount)  # -> out, curve; inputs controlPoints: list of Point3d, iterationCount: Int32
# ---------- c_script: C# ----------
    for (int j = 0; j < iterationCount; j++)
    {
      List<Point3d> newControlPoints = new List<Point3d>();

      for (int i = 0; i < controlPoints.Count - 1; i++)
      {
        Point3d oneQuarterPoint = 0.75 * controlPoints[i] + 0.25 * controlPoints[i + 1];
        Point3d threeQuarterPoint = 0.25 * controlPoints[i] + 0.75 * controlPoints[i + 1];
        newControlPoints.Add(oneQuarterPoint);
        newControlPoints.Add(threeQuarterPoint);
      }

      controlPoints = newControlPoints;
    }

    curve = new PolylineCurve(controlPoints);
# ---------- end c_script ----------
